% Simulink data dictionary AOTDataDictionary.sldd

Acceleration_ISO = Simulink.Bus()
  xddot: double
  yddot: double
  zddot: double

AngVel_ISO = Simulink.Bus()
  p: double
  q: double
  r: double

Orientation_ISO = Simulink.Bus()
  phi: double
  theta: double
  psi: double

Position_ISO = Simulink.Bus()
  X: double
  Y: double
  Z: double

Velocity_ISO = Simulink.Bus()
  Xdot: double
  Ydot: double
  Zdot: double

Veh_Fdbk = Simulink.Bus()
  Position_ISO: Position_ISO
  Velocity_ISO: Velocity_ISO
  Acceleration_ISO: Acceleration_ISO
  Orientation_ISO: Orientation_ISO
  AngVel_ISO: AngVel_ISO

L = 3.705
amax = 5
amin = -10
delta_max = 0.6981317
delta_min = -0.6981317
dt = 0.05
l_F = 1.2525
tf = 1
v_des = 15

BusActors = Simulink.Bus()
  NumActors: double
  Time: double
  Actors: Bus: BusActorsActors

BusActorsActors = Simulink.Bus()
  ActorID: double
  Position: double[1 3]
  Velocity: double[1 3]
  Roll: double
  Pitch: double
  Yaw: double
  AngularVelocity: double[1 3]

BusLaneBoundaries = Simulink.Bus()
  NumLaneBoundaries: double
  Time: double
  LaneBoundaries: Bus: BusLaneBoundariesLaneBoundaries[7 1]

BusLaneBoundariesLaneBoundaries = Simulink.Bus()
  Coordinates: double[401 3]
  Curvature: double[401 1]
  CurvatureDerivative: double[401 1]
  HeadingAngle: double
  LateralOffset: double
  BoundaryType: uint8
  Strength: double
  Width: double
  Length: double
  Space: double

BusVehicleToWorldActors = Simulink.Bus()
  NumActors: double
  Time: double
  Actors: Bus: BusActorsActors